# Grasshopper definition bezier.gh (Grasshopper 1.0.7)
# plug-ins: Anemone

pt = Point([Point(-1000, -42000, 0), Point(-23000, -38000, 0), Point(-34000, -8000, 0), Point(-10000, 6000, 0), Point(-3000, 20000, 0), Point(39000, 5000, 0), Point(33000, -33000, 0)])

# ---- group: パラメータtによる内分点単体プロット
t = Slider(0.607, range=0..1)
pline = PolyLine(Vertices=pt, Closed=False)
explode = Explode(Curve=pline, Recursive=True)  # -> reparameterize(Segments), Vertices
eval = EvaluateCurve(Curve=explode.Segments, Parameter=graft(t))  # -> Point, Tangent, Angle
pline_2 = PolyLine(Vertices=eval.Point, Closed=False)
explode_2 = Explode(Curve=pline_2, Recursive=True)  # -> reparameterize(Segments), Vertices
eval_2 = EvaluateCurve(Curve=explode_2.Segments, Parameter=graft(t))  # -> Point, Tangent, Angle
pline_3 = PolyLine(Vertices=eval_2.Point, Closed=False)
explode_3 = Explode(Curve=pline_3, Recursive=True)  # -> reparameterize(Segments), Vertices
eval_3 = EvaluateCurve(Curve=explode_3.Segments, Parameter=graft(t))  # -> Point, Tangent, Angle
pline_4 = PolyLine(Vertices=eval_3.Point, Closed=False)
explode_4 = Explode(Curve=pline_4, Recursive=True)  # -> reparameterize(Segments), Vertices
eval_4 = EvaluateCurve(Curve=explode_4.Segments, Parameter=graft(t))  # -> Point, Tangent, Angle
pline_5 = PolyLine(Vertices=eval_4.Point, Closed=False)
explode_5 = Explode(Curve=pline_5, Recursive=True)  # -> reparameterize(Segments), Vertices
eval_5 = EvaluateCurve(Curve=explode_5.Segments, Parameter=graft(t))  # -> Point, Tangent, Angle
pline_6 = PolyLine(Vertices=eval_5.Point, Closed=False)
explode_6 = Explode(Curve=pline_6, Recursive=True)  # -> reparameterize(Segments), Vertices
eval_6 = EvaluateCurve(Curve=explode_6.Segments, Parameter=graft(t))  # -> flatten(Point), Tangent, Angle
sph = Sphere(Base=eval_6.Point, Radius=1000)

# ----
lng = ListLength(List=pt)

# ---- group: ループ処理による内分点複数プロット
number_slider = Slider(30, range=0..30)
fastloopstart = FastLoopStart(Iterations=lng, Data=pt)  # -> port, Counter, Data
pline_7 = PolyLine(Vertices=fastloopstart.Data, Closed=False)
range = Range(Domain=Domain(0, 1), Steps=number_slider)
explode_7 = Explode(Curve=pline_7, Recursive=True)  # -> reparameterize(Segments), Vertices
eval_7 = EvaluateCurve(Curve=explode_7.Segments, Parameter=graft(range))  # -> Point, Tangent, Angle
fastloopend = FastLoopEnd(port=fastloopstart.port, Exit=Toggle(False), Data=eval_7.Point, RecordData=True, TimeOutVal=0)  # -> flatten(Data)
series = Series(Start="-1", Step="-1", Count=number_slider)
item = ListItem(List=fastloopend, Index=series, Wrap=True)

# ---- group: 既存コマンドによるベジェ曲線
subtraction = Subtraction(A=lng, B="1")
nurbs = NurbsCurve(Vertices=pt, Degree=subtraction, Periodic=False)  # -> reparameterize(Curve), Length, Domain

# ---- group: 既存コマンドベジェ＆内分点定義ベジェのパラメータ位置比較
eval_8 = EvaluateCurve(Curve=nurbs.Curve, Parameter=range)  # -> Point, Tangent, Angle
sph_2 = Sphere(Base=item, Radius=1000)
panel = Panel("どちらもtパラメータが同一なら、曲線位置も一致する。すなわち、EvaluateCrvで得られるパラメータは、本来のベジェ曲線定義に則っていると考えてよい。")

# ----
preview = CustomPreview(Geometry=sph, Material=ColourSwatch(SwatchColor=RGB(255, 0, 255)))
